# Grasshopper definition example_scene.gh (Grasshopper 1.0.7)
# plug-ins: glTFexporter

mesh = Mesh(<mesh referenced from the Rhino model>)
mesh_2 = Mesh(<mesh referenced from the Rhino model>)
facen = FaceNormals(Mesh=mesh_2)  # -> Centers, Normals
demesh = DeconstructMesh(Mesh=mesh)  # -> Vertices, Faces, Colours, Normals
pdecon = Deconstruct(Point=facen.Centers)  # -> XComponent, YComponent, ZComponent
pdecon_2 = Deconstruct(Point=demesh.Vertices)  # -> XComponent, YComponent, ZComponent
addition = Addition(A=pdecon.XComponent, B=pdecon.YComponent)
addition_2 = Addition(A=pdecon_2.XComponent, B=pdecon_2.YComponent)
sort = SortList(Keys=addition)  # -> Keys, ValuesA
sort_2 = SortList(Keys=addition_2)  # -> Keys, ValuesA
item = ListItem(List=reverse(sort.Keys), Index=0, Wrap=True)
item_2 = ListItem(List=sort.Keys, Index=0, Wrap=True)
item_3 = ListItem(List=reverse(sort_2.Keys), Index=0, Wrap=True)
item_4 = ListItem(List=sort_2.Keys, Index=0, Wrap=True)
gradient = Gradient(
    LowerLimit=item_2,
    UpperLimit=item,
    Parameter=addition,
    stops=[0: RGB(255, 61, 61), 0.509: RGB(255, 178, 84), 1: RGB(255, 244, 38)])
gradient_2 = Gradient(
    LowerLimit=item_4,
    UpperLimit=item_3,
    Parameter=addition_2,
    stops=[0: RGB(255, 61, 61), 0.509: RGB(255, 178, 84), 1: RGB(255, 244, 38)])

# ----
# MeshBasicMaterial (wireframe)
number_slider = Slider(10, range=0..10)
basicmat = MeshBasicMaterial(
    Color=ColourSwatch(SwatchColor=RGB(255, 132, 87)),
    Wireframe=Toggle(True),
    WireframeLineJoin="round",
    WireframeLineWidth=number_slider)  # -> JSON, Material
mesh_3 = Mesh(<mesh referenced from the Rhino model>)
mesh_4 = Mesh(Mesh=mesh_3, Name="meshBasicMaterial_wireframe", Material=basicmat.Material)  # -> JSON, Geometry

# ----
# Scene Example
panel = Panel("houses")
mesh_5 = Mesh(<mesh referenced from the Rhino model>)
mesh_6 = Mesh(<mesh referenced from the Rhino model>)
meshstdrdmat = MeshStandardMaterial(C=ColourSwatch(SwatchColor=RGB(255, 255, 255)), O=1, R=1, M=0.5, Wl=1)  # -> JSON, Material
meshstdrdmat_2 = MeshStandardMaterial(C=ColourSwatch(SwatchColor=RGB(135, 255, 135)), O=1, R=1, M=0.5, Wl=1)  # -> JSON, Material
meshstdrdmat_3 = MeshStandardMaterial(C=ColourSwatch(SwatchColor=RGB(191, 191, 191)), O=1, R=1, M=0.5, Wl=1)  # -> JSON, Material
merge = Merge(Data1=mesh_6, Data2=mesh_5)
merge_2 = Merge(Data1=panel, Data2="buildings")
mesh_7 = Mesh(<mesh referenced from the Rhino model>)
mesh_8 = Mesh(<mesh referenced from the Rhino model>)
mesh_9 = Mesh(Mesh=merge, Name=merge_2, Material=meshstdrdmat.Material)  # -> JSON, Geometry
mesh_10 = Mesh(Mesh=mesh_7, Name="grass", Material=meshstdrdmat_2.Material)  # -> JSON, Geometry
mesh_11 = Mesh(Mesh=mesh_8, Name="street", Material=meshstdrdmat_3.Material)  # -> JSON, Geometry

# ----
# MeshStandardMaterial (metallic)
number_slider_2 = Slider(0.2, range=0..1)
meshstdrdmat_4 = MeshStandardMaterial(C=ColourSwatch(SwatchColor=RGB(255, 132, 87)), O=1, R=number_slider_2, M=Slider(0.5, range=0..1), Wl=1)  # -> JSON, Material
mesh_12 = Mesh(<mesh referenced from the Rhino model>)
mesh_13 = Mesh(Mesh=mesh_12, Name="meshStandardMaterial", Material=meshstdrdmat_4.Material)  # -> JSON, Geometry

# ----
# MeshStandardMaterial (emissive)
number_slider_3 = Slider(0.2, range=0..1)
meshstdrdmat_5 = MeshStandardMaterial(
    C=ColourSwatch(SwatchColor=RGB(255, 132, 87)),
    O=1,
    R=number_slider_3,
    M=Slider(0.5, range=0..1),
    E=ColourSwatch(SwatchColor=RGB(0, 183, 255)),
    W=Slider(0.6, range=0..1),
    Wl=1)  # -> JSON, Material
mesh_14 = Mesh(<mesh referenced from the Rhino model>)
mesh_15 = Mesh(Mesh=mesh_14, Name="meshStandardMaterial", Material=meshstdrdmat_5.Material)  # -> JSON, Geometry

# ----
# MeshVertexColors w/Faces Colored
# note: While it looks like this component is coloring the mesh faces directly, its actually unwelding the mesh edges and coloring the vertices surrounding each face.
# note: Both meshBasicMaterial and meshStandardMaterial components can be used with MeshVertexColors.
# 
# note: MeshVertexColors component overides any color set by the material component.
colorface = MeshColorFaces(Mesh=mesh_2, Color=gradient)
meshstdrdmat_6 = MeshStandardMaterial(C=RGB(100, 149, 237), O=1, R=1, M=0.5, Wl=1)  # -> JSON, Material
meshvertex = MeshVertexColors(Mesh=colorface, Name="mesh_face_colors", Material=meshstdrdmat_6.Material)  # -> JSON, Geometry

# ----
# MeshVertexColors
# note: Both meshBasicMaterial and meshStandardMaterial components can be used with MeshVertexColors.
# 
# note: MeshVertexColors component overides any color set by the material component.
mcol = MeshColours(Mesh=mesh, Colours=gradient_2)
meshstdrdmat_7 = MeshStandardMaterial(C=RGB(100, 149, 237), O=1, R=1, M=0.5, Wl=1)  # -> JSON, Material
meshvertex_2 = MeshVertexColors(Mesh=mcol, Name="mesh_vertex_colors", Material=meshstdrdmat_7.Material)  # -> JSON, Geometry

# ----
# MeshStandardMaterial
swatch = ColourSwatch(SwatchColor=RGB(255, 132, 87))
meshstdrdmat_8 = MeshStandardMaterial(C=swatch, O=1, R=1, M=0.5, Wl=1)  # -> JSON, Material
mesh_16 = Mesh(<mesh referenced from the Rhino model>)
mesh_17 = Mesh(Mesh=mesh_16, Name="meshStandardMaterial", Material=meshstdrdmat_8.Material)  # -> JSON, Geometry

# ----
# Annotations
swatch_2 = ColourSwatch(SwatchColor=RGB(87, 157, 255))
basicmat_2 = MeshBasicMaterial(Color=swatch_2, Wireframe=False, WireframeLineJoin="round", WireframeLineWidth=1)  # -> JSON, Material
mesh_18 = Mesh([<mesh referenced from the Rhino model> x9])
mesh_19 = Mesh(Mesh=mesh_18, Name="captions", Material=basicmat_2.Material)  # -> JSON, Geometry

# ----
# MeshBasicMaterial
swatch_3 = ColourSwatch(SwatchColor=RGB(255, 132, 87))
basicmat_3 = MeshBasicMaterial(Color=swatch_3, Wireframe=False, WireframeLineJoin="round", WireframeLineWidth=1)  # -> JSON, Material
mesh_20 = Mesh(<mesh referenced from the Rhino model>)
mesh_21 = Mesh(Mesh=mesh_20, Name="meshBasicMaterial", Material=basicmat_3.Material)  # -> JSON, Geometry

# ----
# MeshNormalMaterial
panel_2 = Panel("meshNormalMaterial")
normalmat = MeshNormalMaterial(Wireframe=False, WireframeLineJoin="round", WireframeLineWidth=1)  # -> JSON, Material
mesh_22 = Mesh(<mesh referenced from the Rhino model>)
mesh_23 = Mesh(Mesh=mesh_22, Name=panel_2, Material=normalmat.Material)  # -> JSON, Geometry

# ----
# note: You can interpolate the colors on the vertices by welding the mesh edges.
weld = WeldMesh(Mesh=colorface, Angle=3.141592654)

merge_3 = Merge(
    Data1=mesh_23.Geometry,
    Data2=mesh_21.Geometry,
    Data3=mesh_4.Geometry,
    Data4=mesh_17.Geometry,
    Data5=mesh_13.Geometry,
    Data6=mesh_15.Geometry,
    Data7=meshvertex_2.Geometry,
    Data8=meshvertex.Geometry,
    Data9=mesh_9.Geometry,
    Data10=mesh_10.Geometry,
    Data11=mesh_11.Geometry,
    Data12=mesh_19.Geometry)

# ----
# Compile Scene and Export
scene = CompileScene(Geometry=flatten(merge_3))  # -> JSON, Scene
json = ExportJSON(Path="C:\Users\dee\Desktop\vue-threejs-template\public\3d", FileName="example_scene", Data=scene.Scene)
